# Grasshopper definition HVACSystemWorkflow.gh (Grasshopper 0.9.76)
# plug-ins: Python Interpreter, Ironbug.Grasshopper

brep = Brep([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])
honeybee = Honeybee_Honeybee()  # -> Vviiiiiiiiiizzz; plug-in component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
ladybug = Ladybug_Ladybug()  # -> Vviiiiiiiiiizzz; plug-in component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
intersectmass = IntersectMass(x=brep)  # -> out, A; inputs x: list of Brep
# ---------- intersectmass: C# ----------
    var tolerance = Rhino.RhinoDoc.ActiveDoc.ModelAbsoluteTolerance;
    List<Brep> allOldBreps = x;

    if (x.Count() > 0)
    {
      var results = allOldBreps.AsParallel().AsOrdered().Select(b => SplitBrepWithBreps(b, allOldBreps, tolerance));
      A = results;
    }

    //SplitBrepWithBreps(x[0], x, tolerance);
# ---------- intersectmass: C# additional code ----------
  static Brep SplitBrepWithBreps(Brep CurrentBrep, List<Brep> AllBreps, double tolerance)
  {
    var currentBrep = CurrentBrep;
    var allBreps = AllBreps;

    foreach (Brep item in allBreps)
    {
      var  tempBrep = currentBrep.Split(item, tolerance);
      if (tempBrep.Count() > 0)
      {
        var newBrep = Rhino.Geometry.Brep.JoinBreps(tempBrep, tolerance);

        currentBrep = newBrep.First();
        currentBrep.Faces.ShrinkFaces();
      }
    }
    return currentBrep;

  }
# ---------- end intersectmass ----------
number_slider = Slider(0.7, range=0..1)
mass2zone = Honeybee_Masses2Zones(zoneMasses=flatten(intersectmass.A), maxRoofAngle=30, createHBZones=Toggle(True))  # -> readMe, HBZones; plug-in component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
panel = Panel("https://www.energyplus.net/weather-download/north_and_central_america_wmo_region_4/USA/NY/USA_NY_New.York-LaGuardia.AP.725030_TMY3/all")
glzparamlist = Honeybee_GlazingParametersList(northGlzParam=0, westGlzParam=0, southGlzParam=number_slider, eastGlzParam=number_slider)  # -> glzParamList; plug-in component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
solveadjc = Honeybee_SolveAdjacencies(HBZones=flatten(mass2zone.HBZones), removeCurrentAdjc=False, findAdjc=Toggle(True))  # -> readMe, HBZonesWADJ; plug-in component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
glazingcreator = Honeybee_GlazingBasedOnRatio(HBObjects=solveadjc.HBZonesWADJ, glzRatio=glzparamlist, runIt=Toggle(True))  # -> readMe, HBObjWGLZ; plug-in component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
epw_stat = Ladybug_OpenEPWAndSTATWeatherFiles(weatherFileURL=panel)  # -> epwFile, statFile; plug-in component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
separatezonesbyfloor = Honeybee_SeparateZonesByFloor(HBZones=flatten(glazingcreator.HBObjWGLZ))  # -> floorHeights, HBZones; plug-in component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
hvacsystemslist = Honeybee_HVACSystemsList({"-1. Thermostat Only": -1, "0. Ideal Air Loads": 0, "1. PTAC | Residential": 1, "2. PTHP | Residential": 2, "3. Packaged Single Zone - AC": 3, "4. Packaged Single Zone - HP": 4, "5. Packaged VAV w/ Reheat": 5, "6. Packaged VAV w/ PFP Boxes": 6, "7. VAV w/ Reheat": 7, "8. VAV w/ PFP Boxes": 8, "9. Warm Air Furnace - Gas Fired": 9, "10.Warm Air Furnace - Electric": 10, "11.Fan Coil Units + DOAS": 11, "12.Active Chilled Beams + DOAS": 12, "13.Radiant Floors + DOAS": 13, "14.Custom Rad Surfaces + DOAS": 14, "15.Heated Surfaces + VAV Cooling": 15, "16.VRF + DOAS": 16, "17.WSHP + DOAS": 17}, selected="7. VAV w/ Reheat")

# ---- group: Sys07_VAV Reheat
# Double click the component for more details
sys07 = Sys07(hbzones=flatten(separatezonesbyfloor.HBZones))

# ----
hvacsystem = Honeybee_AssignHVACSystem(HBZones=glazingcreator.HBObjWGLZ, HVACSystems=hvacsystemslist)  # -> readMe, HBZones; plug-in component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
hvactemplate = Ironbug_HVACTemplate()
toggle = BooleanToggle(False)
toggle_2 = BooleanToggle(False)
exporttoopenstudio = Honeybee_ExportToOpenStudio(
    epwWeatherFile=epw_stat.epwFile,
    HBZones=flatten(glazingcreator.HBObjWGLZ),
    HVACSystem=flatten(sys07),
    writeOSM=toggle,
    runSimulation=toggle,
    fileName="IB_Sys")  # -> readMe, osmFileAddress, idfFileAddress, resultFileAddress, eioFileAddress, rddFileAddress, htmlReport, studyFolder, model; plug-in component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
exporttoopenstudio_2 = Honeybee_ExportToOpenStudio(
    epwWeatherFile=epw_stat.epwFile,
    HBZones=flatten(hvacsystem.HBZones),
    writeOSM=toggle_2,
    runSimulation=toggle_2,
    fileName="HB_SYS")  # -> readMe, osmFileAddress, idfFileAddress, resultFileAddress, eioFileAddress, rddFileAddress, htmlReport, studyFolder, model; plug-in component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
readepresult = Honeybee_ReadEPResult(resultFileAddress=exporttoopenstudio.resultFileAddress)  # -> totalThermalLoad, thermalLoadBalance, cooling, heating, electricLight, electricEquip, fanElectric, pumpElectric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; plug-in component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
readepresult_2 = Honeybee_ReadEPResult(resultFileAddress=exporttoopenstudio_2.resultFileAddress)  # -> totalThermalLoad, thermalLoadBalance, cooling, heating, electricLight, electricEquip, fanElectric, pumpElectric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; plug-in component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
strnum = Ladybug_SeparateData(inputList=flatten(readepresult_2.cooling))  # -> numbers, strings; plug-in component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
strnum_2 = Ladybug_SeparateData(inputList=flatten(readepresult_2.heating))  # -> numbers, strings; plug-in component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
strnum_3 = Ladybug_SeparateData(inputList=flatten(readepresult.cooling))  # -> numbers, strings; plug-in component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
strnum_4 = Ladybug_SeparateData(inputList=flatten(readepresult.heating))  # -> numbers, strings; plug-in component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
ma = MassAddition(Input=flatten(strnum.numbers))  # -> Result, PartialResults
ma_2 = MassAddition(Input=flatten(strnum_3.numbers))  # -> Result, PartialResults
ma_3 = MassAddition(Input=strnum_2.numbers)  # -> Result, PartialResults
ma_4 = MassAddition(Input=strnum_4.numbers)  # -> Result, PartialResults
panel_2 = Panel(ma_4.Result)
panel_3 = Panel(ma_2.Result)
panel_4 = Panel(ma_3.Result)
panel_5 = Panel(ma.Result)

# ==== cluster Sys07
hbzones = ClusterInput()

# ----
# HBZones
brep = Brep(flatten(hbzones))
boiler = Ironbug_BoilerHotWater()

# ----
# Sys07_VAV_Reheat
# Airloop
panel = Panel("DifferentialDryBulb")
lng = ListLength(List=brep)
coilhtnwater = Ironbug_CoilHeatingWater()  # -> AirSide_CoilHeatingWater, WaterSide_CoilHeatingWater
objparams = Ironbug_ObjParams(EconomizerControlType=panel, DataFieldSetType="Ironbug.HVAC.IB_ControllerOutdoorAir_FieldSet")
duplicate = Ironbug_Duplicate(Reference=coilhtnwater.AirSide_CoilHeatingWater, Amount=lng)  # -> Objects, WaterSide_CoilHeatingWater
objparams_2 = Ironbug_ObjParams(PressureRise="500", DataFieldSetType="Ironbug.HVAC.IB_FanVariableVolume_FieldSet")
oacontroller = Ironbug_OAController(Parameters_=objparams)
objparams_3 = Ironbug_ObjParams(
    AllOutdoorAirinCooling=Toggle(False),
    AllOutdoorAirinHeating=Toggle(False),
    CentralHeatingDesignSupplyAirTemperature="12.8",
    DataFieldSetType="Ironbug.HVAC.IB_SizingSystem_FieldSet")
vavreheat = Ironbug_AirTerminalSingleDuctVAVReheat(HeatingCoil=duplicate.Objects)
coilclnwater = Ironbug_CoilCoolingWater()  # -> AirSide_CoilCoolingWater, WaterSide_CoilCoolingWater
coilhtnwater_2 = Ironbug_CoilHeatingWater()  # -> AirSide_CoilHeatingWater, WaterSide_CoilHeatingWater
oasystem = Ironbug_OutdoorAirSystem(Controller_=oacontroller)
thermalzone = Ironbug_ThermalZone(HoneybeeZonesOrOsZones=brep, AirTerminal_=vavreheat, IsAirTerminalPriorToZoneEquipments=True)
fanvariable = Ironbug_FanVariableVolume(Parameters=objparams_2)
spm_scheduled = Ironbug_SetpointManagerScheduled(Temperature="12.8")
branches = AirLoopBranches(Branch1=thermalzone)
sizingsystem = Ironbug_SizingSystem(Parameters_=objparams_3)
merge = Merge(
    Data1=oasystem,
    Data2=coilclnwater.AirSide_CoilCoolingWater,
    Data3=coilhtnwater_2.AirSide_CoilHeatingWater,
    Data4=fanvariable,
    Data5=spm_scheduled)
airloop = Ironbug_AirLoopHVAC(Supply=merge, Demand=branches, SizingSystem=sizingsystem)

# ----
# Chilled water loop
chiller_watercooled = Ironbug_ChillerElectricEIR_WaterCooled()  # -> ChillerElectricEIR, ChillerElectricEIR_CondenserLoop
pumpvariable = Ironbug_PumpVariableSpeed()
branches_2 = PlantBranches(Branch1=chiller_watercooled.ChillerElectricEIR)
spm_scheduled_2 = Ironbug_SetpointManagerScheduled(Temperature="6.7")
branches_3 = PlantBranches(Branch1=coilclnwater.WaterSide_CoilCoolingWater)
cwloop = Ironbug_ChilledWaterPlantLoop(Supply=[pumpvariable, branches_2, spm_scheduled_2], Demand=branches_3)

# ----
# Condenser water loop
coolingtower1 = Ironbug_CoolingTowerSingleSpeed()
pipeadiabatic = Ironbug_PipeAdiabatic()
spm_followoatemp = Ironbug_SetpointManagerFollowOutdoorAirTemperature(MaximumSetpointTemperature="80", MinimumSetpointTemperature="6", OffsetTemperatureDifference="1.5")
pumpvariable_2 = Ironbug_PumpVariableSpeed()
plantbranches = PlantBranches(Branch1=chiller_watercooled.ChillerElectricEIR_CondenserLoop)
branches_4 = PlantBranches(B1=coolingtower1, B2=pipeadiabatic)
dwloop = Ironbug_CondenserWaterPlantLoop(Supply=[pumpvariable_2, branches_4, spm_followoatemp], Demand=plantbranches)

graft = GraftTree(Tree=duplicate.WaterSide_CoilHeatingWater, IncludeEmptyLists=True, IncludeNullItems=True)

# ----
# Hot water loop
panel_2 = Panel("67")
pumpvariable_3 = Ironbug_PumpVariableSpeed()
plantbranches_2 = PlantBranches(Branch1=boiler)
spm_scheduled_3 = Ironbug_SetpointManagerScheduled(Temperature=panel_2)
branches_5 = PlantBranches(B1=graft, B2=coilhtnwater_2.WaterSide_CoilHeatingWater)
hwloop = Ironbug_HotWaterPlantLoop(Supply=[pumpvariable_3, plantbranches_2, spm_scheduled_3], Demand=branches_5)

merge_2 = Merge(Data1=hwloop, Data2=cwloop, Data3=dwloop)
hvacsystem = Ironbug_HVACSystem(AirLoops=flatten(airloop), PlantLoops=flatten(merge_2))

hvacsystem_2 = ClusterOutput(hvacsystem)
